# Grasshopper definition TransformHintTest.gh (Grasshopper 1.0.7)
# plug-ins: Hops

y_rotation = Slider(0.927, range=0..3.142)
cos = Cosine(Value=y_rotation)
sin = Sine(Value=y_rotation)
panel = Panel("""1
0
0
0
0
1
0
0
0
0
1
0
0
0
0
1""")
replace = ReplaceItems(List=panel, Item=cos, Indices=[0, 10], Wrap=False)
neg = Negative(Value=sin)
replace_2 = ReplaceItems(List=replace, Item=sin, Indices=2, Wrap=False)
replace_3 = ReplaceItems(List=replace_2, Item=neg, Indices=8, Wrap=False)
panel_2 = Panel("""1
0
0
.05
0
1
0
6
0
0
1
3
0
0
0
1""")
panel_3 = Panel(replace_3)
panel_4 = Panel(""".773
-.633
0
0
.633
.773
0
0
0
0
1
0
0
0
0
1""")
matrix = ConstructMatrix(Rows="4", Columns="4", Values=panel_4)
matrix_2 = ConstructMatrix(Rows="4", Columns="4", Values=panel_3)
matrix_3 = ConstructMatrix(Rows="4", Columns="4", Values=panel_2)
multiplication = Multiplication(A=matrix_3, B=matrix_2, C=matrix)
dematrix = DeconstructMatrix(Matrix=multiplication)  # -> Rows, Columns, Values
hops = Hops(
    MatrixArray=dematrix.Values,
    Scale=0.2,
    CacheResultsInMemory=True,
    CacheSolveResults=True,
    RemoteDefinitionLocation="C:\dev\github\nathan-barnes\atom2bits2atoms\TransformHint.gh",
    RemoteSolveVersion=(0, 1, 0),
    ShowInput_Enabled=False,
    ShowInput_Path=False,
    SynchronousSolve=True)
panel_5 = Panel(dematrix.Values)
