# Grasshopper definition fologram_test4.gh (Grasshopper 1.0.7)
# plug-ins: FologramForGrasshopper, Fologram For Grasshopper Utilities

# ---- group: to view final chair stack
# - AECtech 2022
# - Team: Remap
# - Contributor: Quoc Dang
# This GH script is created to view AR directive instructions to build certain structure in field.
connected_devices = ConnectedDevices(device_filter=3, hasSerializedData=True)
track_markers = TrackMarkers(Device=connected_devices, hasSerializedData=True, marker_output_type=96, marker_trackable_size=45, update_mode=1)
device = TrackDevice(Device=connected_devices, hasSerializedData=True, update_mode=1)
panel = Panel(track_markers)
geo = Geometry([<mesh referenced from the Rhino model> x5])
panel_2 = Panel(geo)
sync = SyncObject(
    GM=geo,
    AlwaysIncludeTextureCoordinates=False,
    Clickable=False,
    DefaultCurveThicknessMillimeters=2.5,
    DefaultGlossPercent=0,
    DefaultMaterialColor=RGBA(0, 247, 58, 32),
    DefaultSpecularPercent=0,
    Grabbable=False,
    Interactive=False,
    Occlusion=False,
    Outline=True,
    hasSerializedData=True)

# ----
srf = Surface(<surface referenced from the Rhino model>)  # disabled
pln = Plane(srf)  # disabled

pt = Point(<point referenced from the Rhino model>)  # disabled
pt_2 = Point(<point referenced from the Rhino model>)  # disabled
ln = Line(StartPoint=pt, EndPoint=pt_2)  # disabled
vec2pt = Vector2Pt(PointA=pt, PointB=pt_2, Unitize=False)  # -> Vector, Length; disabled
X = UnitX(Factor=1)  # disabled
geo_2 = Geometry(<mesh referenced from the Rhino model>)  # disabled
pl = ConstructPlane(Origin=pt_2, XAxis=X, YAxis=vec2pt.Vector)  # disabled
orient = Orient(Geometry=geo_2, Source=pl, Target=pln)  # -> Geometry, Transform; disabled

# ---- group: to view transformation instruction for a single chair
connected_devices_2 = ConnectedDevices(device_filter=3, hasSerializedData=True)  # disabled
track_markers_2 = TrackMarkers(Device=connected_devices_2, hasSerializedData=True, marker_output_type=96, marker_trackable_size=45, update_mode=1)  # disabled
device_2 = TrackDevice(Device=connected_devices_2, hasSerializedData=True, update_mode=1)  # disabled
panel_3 = Panel(track_markers_2)
panel_4 = Panel("22.5")
plane = Plane(track_markers_2)
addition = Addition(A=panel_4, B=Slider(60, range=0..100))
panel_5 = Panel(plane)
set_global_value = SetGlobalValue(ArucoPlane=plane)  # disabled
set_global_value_2 = SetGlobalValue(ArucoPlane=plane)  # disabled
box = CenterBox(Base=plane, X=panel_4, Y=panel_4, Z=panel_4)
number_slider = Slider(0, range=0..4)
line = LineSDL(Start=plane, Direction=plane, Length=addition)
end = EndPoints(Curve=line)  # -> Start, End
vec2pt_2 = Vector2Pt(PointA=end.Start, PointB=end.End, Unitize=False)  # -> Vector, Length
geo_3 = Geometry(<mesh referenced from the Rhino model>)
sync_2 = SyncObject(
    GM=box,
    AlwaysIncludeTextureCoordinates=False,
    Clickable=False,
    DefaultCurveThicknessMillimeters=2.5,
    DefaultGlossPercent=0,
    DefaultMaterialColor=RGBA(49, 80, 235, 215),
    DefaultSpecularPercent=0,
    Grabbable=False,
    Interactive=False,
    Occlusion=False,
    Outline=False,
    hasSerializedData=True)
move = Move(Geometry=geo_3, Motion=vec2pt_2.Vector)  # -> Geometry, Transform

pt_3 = Point(<point referenced from the Rhino model>)
pt_4 = Point(<point referenced from the Rhino model>)
ln_2 = Line(StartPoint=pt_3, EndPoint=pt_4)
vec2pt_3 = Vector2Pt(PointA=pt_3, PointB=pt_4, Unitize=False)  # -> Vector, Length
X_2 = UnitX(Factor=1)
geo_4 = Geometry([<mesh referenced from the Rhino model> x2, <brep referenced from the Rhino model> x4])
pl_2 = ConstructPlane(Origin=pt_4, XAxis=X_2, YAxis=vec2pt_3.Vector)
orient_2 = Orient(Geometry=geo_4, Source=pl_2, Target=plane)  # -> Geometry, Transform

item = ListItem(List=orient_2.Geometry, Index=number_slider, Wrap=True)
panel_6 = Panel(item)
cull_i = CullIndex(List=orient_2.Geometry, Indices=number_slider, Wrap=True)
sync_3 = SyncObject(
    GM=cull_i,
    AlwaysIncludeTextureCoordinates=False,
    Clickable=False,
    DefaultCurveThicknessMillimeters=2.5,
    DefaultGlossPercent=0,
    DefaultMaterialColor=RGBA(19, 54, 232, 116),
    DefaultSpecularPercent=0,
    Grabbable=False,
    Interactive=False,
    Occlusion=False,
    Outline=False,
    hasSerializedData=True)
panel_7 = Panel(orient_2.Geometry)
sync_4 = SyncObject(
    GM=item,
    AlwaysIncludeTextureCoordinates=False,
    Clickable=False,
    DefaultCurveThicknessMillimeters=2.5,
    DefaultGlossPercent=0,
    DefaultMaterialColor=RGBA(0, 247, 58, 32),
    DefaultSpecularPercent=0,
    Grabbable=False,
    Interactive=False,
    Occlusion=False,
    Outline=True,
    hasSerializedData=True)

# ----
line_2 = LineSDL(Start=pln, Direction=pln, Length=addition)  # disabled
box_2 = CenterBox(Base=srf, X=panel_4, Y=panel_4, Z=panel_4)  # disabled
end_2 = EndPoints(Curve=line_2)  # -> Start, End; disabled
vec2pt_4 = Vector2Pt(PointA=end_2.Start, PointB=end_2.End, Unitize=False)  # -> Vector, Length; disabled
move_2 = Move(Geometry=geo_2, Motion=vec2pt_4.Vector)  # -> Geometry, Transform; disabled
